# Grasshopper definition Ouroboros AI.gh (Grasshopper 1.0.8)
# plug-ins: Pufferfish

api_key = Panel("\"YOUR_FORTYGUARD_API_KEY_HERE\"")
boolean_toggle = BooleanToggle(True)
# APIs and Data Pull
python_3_script = Python3Script(Lat="40.720418", Lon="-73.988780", Radius=Slider(100, range=0..100), RunOSM=Toggle(True))  # -> out, OfficeBreps, ResidentialBreps, PedestrianPaths, VehicularRoads, Status; inputs Lat: Double, Lon: Double, Radius: Double, RunOSM: Boolean
# ---------- python_3_script: Python ----------
import json
import urllib.request
import Rhino.Geometry as rg
import math

# Initialize outputs
OfficeBreps = []
ResidentialBreps = []
PedestrianPaths = []
VehicularRoads = []
Status = "Waiting for RunOSM toggle."

def latlon_to_xy(lat, lon, center_lat, center_lon):
    """Converts Lat/Lon to local Cartesian XY in meters."""
    r = 6371000 # Earth radius in meters
    x = math.radians(lon - center_lon) * r * math.cos(math.radians(center_lat))
    y = math.radians(lat - center_lat) * r
    return rg.Point3d(x, y, 0)

if RunOSM:
    Status = "Querying Overpass API..."
    
    # Overpass QL query targeting buildings and roads
    query = f"""
    [out:json];
    (
      way["building"](around:{Radius},{Lat},{Lon});
      way["highway"](around:{Radius},{Lat},{Lon});
    );
    out body;
    >;
    out skel qt;
    """
    
    url = "http://overpass-api.de/api/interpreter"
    data = query.encode('utf-8')
    
    # Headers to satisfy API security rules and prevent 406 Error
    headers = {
        "User-Agent": "ThermoSynthesizeAI-Hackathon/1.0",
        "Accept": "application/json"
    }
    
    req = urllib.request.Request(url, data=data, headers=headers, method='POST')
    
    try:
        with urllib.request.urlopen(req, timeout=45) as response:
            osm_data = json.loads(response.read().decode('utf-8'))
            
            # Map node IDs to coordinates
            nodes = {node['id']: (node['lat'], node['lon']) for node in osm_data['elements'] if node['type'] == 'node'}
            
            for element in osm_data['elements']:
                if element['type'] == 'way' and 'nodes' in element:
                    pts = []
                    for nid in element['nodes']:
                        if nid in nodes:
                            n_lat, n_lon = nodes[nid]
                            pts.append(latlon_to_xy(n_lat, n_lon, Lat, Lon))
                    
                    if len(pts) < 2:
                        continue
                        
                    tags = element.get('tags', {})
                    
                    # Process Buildings
                    if 'building' in tags:
                        # Close the polygon loop if open
                        if pts[0].DistanceTo(pts[-1]) > 0.1:
                            pts.append(pts[0]) 
                        
                        curve = rg.PolylineCurve(pts)
                        
                        # Correct flipped Z-axis extrusions by checking curve orientation
                        if curve.ClosedCurveOrientation(rg.Plane.WorldXY) == rg.CurveOrientation.Clockwise:
                            curve.Reverse()
                        
                        # Extrude based on building levels (defaulting to 3 if tag is missing)
                        levels = float(tags.get('building:levels', 3))
                        height = levels * 3.5 
                        
                        extrusion = rg.Extrusion.Create(curve, height, True)
                        if extrusion:
                            brep = extrusion.ToBrep()
                            # Sort building typologies
                            if tags.get('building') in ['commercial', 'office', 'retail']:
                                OfficeBreps.append(brep)
                            else:
                                ResidentialBreps.append(brep)
                                
                    # Process Roads
                    elif 'highway' in tags:
                        curve = rg.PolylineCurve(pts)
                        # Sort road types for targeted material mitigation
                        if tags.get('highway') in ['pedestrian', 'footway', 'path', 'steps']:
                            PedestrianPaths.append(curve)
                        else:
                            VehicularRoads.append(curve)
                            
        Status = f"Success: Loaded {len(OfficeBreps)} office, {len(ResidentialBreps)} residential buildings, {len(PedestrianPaths)} paths, and {len(VehicularRoads)} roads."
    except Exception as e:
        Status = f"OSM Error: {str(e)}"
# ---------- end python_3_script ----------
python_3_script_2 = Python3Script(ApiKey=api_key, Run=boolean_toggle, CenterLat="40.720418", CenterLon="-73.988780", DateStr="2024-01-20", TimeStr="13:00")  # -> out, BaseTemp, SolarGHI, StatusLog
# ---------- python_3_script_2: Python ----------
import json
import time
import urllib.request
import urllib.error

# 1. Initialize Default Fallback Outputs
BaseTemp = 35.0  
SolarGHI = 850.0 
StatusLog = "Idle. Set 'Run' to True to execute."

def is_within_us(lat, lon):
    """Checks if coordinates fall within the contiguous US bounding box."""
    return (24.396308 <= lat <= 49.384358) and (-125.000000 <= lon <= -66.934570)

def http_post(url, headers, payload):
    data = json.dumps(payload).encode('utf-8')
    req = urllib.request.Request(url, data=data, headers=headers, method='POST')
    with urllib.request.urlopen(req, timeout=30) as resp:
        return json.loads(resp.read().decode('utf-8'))

def http_get(url, headers):
    req = urllib.request.Request(url, headers=headers, method='GET')
    with urllib.request.urlopen(req, timeout=30) as resp:
        return json.loads(resp.read().decode('utf-8'))

if Run:
    if not ApiKey:
        StatusLog = "Warning: No API Key provided. Outputting baseline proxy values."
    else:
        try:
            base_url = "https://api.fortyguard.com/v1"
            headers = {"api-key": ApiKey, "Content-Type": "application/json"}
            
            # Safely handle null coordinate inputs
            lat = float(CenterLat) if CenterLat is not None else 40.7128
            lon = float(CenterLon) if CenterLon is not None else -74.0060
            
            if not is_within_us(lat, lon):
                StatusLog = f"Coords ({lat}, {lon}) outside US bound. Using LTM Proxy Mode."
            else:
                StatusLog = "Connecting to FortyGuard Enterprise API..."
                
                # Fetch maximum of 3 parameters to ensure API Basic plan compliance
                env_payload = {
                    "latitude": lat,
                    "longitude": lon,
                    "temperature": 32.5,
                    "date_time": {
                        "start_date": DateStr if DateStr else "2024-01-20",
                        "start_time": TimeStr if TimeStr else "16:00",
                        "filter_type": 1
                    },
                    "analysis": ["heat_index_celsius", "apparent_temperature_celsius", "solar_irradiance"]
                }
                
                env_res = http_post(f"{base_url}/env_params", headers, env_payload)
                act_id = env_res["data"]["activity_id"]
                StatusLog = f"Task Submitted (ID: {act_id}). Polling engine..."

                # Asynchronous Bounded Polling Loop (Max 60 seconds)
                completed = False
                for _ in range(20):
                    time.sleep(3)
                    st_res = http_get(f"{base_url}/status/{act_id}", headers)
                    st_data = st_res.get("data", {})
                    st_val = st_data.get("status", "").lower()
                    
                    if st_val in ("completed", "succeeded"):
                        result = st_data.get("result", {})
                        locs = result.get("locations", [{}])[0]
                        params = locs.get("parameters", {})
                        
                        # Safely extract dynamic JSON paths
                        hi_list = params.get("heat_index_celsius", [35.0])
                        BaseTemp = float(hi_list[0]) if (hi_list and hi_list[0] is not None) else 35.0
                        
                        solar_data = locs.get("solar_irradiance", {}).get("clear_sky", {})
                        SolarGHI = float(solar_data.get("ghi", 850.0))
                        
                        completed = True
                        StatusLog = "Success: FortyGuard Live Data loaded."
                        break
                    elif st_val in ("failed", "error"):
                        StatusLog = f"Task {act_id} failed. Outputting baseline proxy values."
                        break
                        
                if not completed:
                    StatusLog = "Polling timeout. Outputting baseline proxy values."

        except Exception as e:
            StatusLog = f"API Execution Error: {str(e)}. Defaulting to proxy values."
# ---------- end python_3_script_2 ----------
panel = Panel(python_3_script_2.StatusLog)
python_3_script_3 = Python3Script(ApiKey=api_key, RunVision=boolean_toggle, Lat="40.720418", Lon="-73.988780")  # -> out, GlassRatio, WallRatio, VisionStatus; inputs RunVision: Boolean, Lat: Double, Lon: Double
# ---------- python_3_script_3: Python ----------
import json
import urllib.request

GlassRatio = 0.55 # Default fallback proxy
WallRatio = 0.45
VisionStatus = "Idle. Set 'RunVision' to True."

if RunVision:
    if not ApiKey:
        VisionStatus = "Warning: No API Key provided. Using default material ratios."
    else:
        try:
            base_url = "https://api.fortyguard.com/v1"
            headers = {"api-key": ApiKey, "Content-Type": "application/json"}
            
            # Payload for FortyGuard Satellite/Street View Segmentation
            vision_payload = {
                "latitude": float(Lat) if Lat else 40.7128,
                "longitude": float(Lon) if Lon else -74.0060,
                "analysis_type": "material_segmentation"
            }
            
            data = json.dumps(vision_payload).encode('utf-8')
            req = urllib.request.Request(f"{base_url}/satellite", data=data, headers=headers, method='POST')
            
            with urllib.request.urlopen(req, timeout=30) as resp:
                res_json = json.loads(resp.read().decode('utf-8'))
                result_data = res_json.get("data", {}).get("segmentation", {})
                
                # Extract quantified material ratios from FortyGuard's vision model
                GlassRatio = float(result_data.get("glass_ratio", 0.55))
                WallRatio = float(result_data.get("wall_ratio", 0.45))
                
                VisionStatus = "Success: FortyGuard vision segmentation loaded."
                
        except Exception as e:
            VisionStatus = f"Vision API Fallback Active: {str(e)}"
# ---------- end python_3_script_3 ----------
panel_2 = Panel(python_3_script.Status)
number_slider = Slider(0.4, range=0..1)
number_slider_2 = Slider(0.6, range=0..1)
bounding_rectangle = BoundingRectangle(
    Geometry=flatten([python_3_script.OfficeBreps, python_3_script.ResidentialBreps, python_3_script.PedestrianPaths, python_3_script.VehicularRoads]),
    Plane=PlaneXY(0, 0, 0),
    Axis=0,
    Slide=0,
    Union=True)  # -> Bounding, DimensionX, DimensionY
boundary_surfaces = BoundarySurfaces(Edges=bounding_rectangle.Bounding)
construct_point = ConstructPoint(XCoordinate=number_slider_2, YCoordinate=number_slider, ZCoordinate=0)
# Pedestrian & Vehicular Paths
offset_curve = OffsetCurve(
    Curve=python_3_script.PedestrianPaths,
    Plane=PlaneXY(0, 0, 0),
    Distance=Slider(2, range=1..3),
    BothSides=Toggle(True),
    Kinks=0,
    CapType=1)
offset_curve_2 = OffsetCurve(
    Curve=python_3_script.VehicularRoads,
    Plane=PlaneXY(0, 0, 0),
    Distance=Slider(3, range=3..7),
    BothSides=Toggle(True),
    Kinks=0,
    CapType=1)
evaluate_surface = EvaluateSurface(Surface=reparameterize(boundary_surfaces), Point=construct_point)  # -> Point, Normal, UDirection, VDirection, Frame
boundary_surfaces_2 = BoundarySurfaces(Edges=offset_curve)
boundary_surfaces_3 = BoundarySurfaces(Edges=offset_curve_2)
area = Area(Geometry=boundary_surfaces_2)  # -> Area, Centroid
area_2 = Area(Geometry=boundary_surfaces_3)  # -> Area, Centroid
region_union = RegionUnion(Curves=flatten(offset_curve))
number_slider_3 = Slider(40, range=0..100)
mass_addition = MassAddition(Input=flatten(area.Area))  # -> Result, PartialResults
mass_addition_2 = MassAddition(Input=flatten(area_2.Area))  # -> Result, PartialResults
# Landscape Tree Generation
boundary_surfaces_4 = BoundarySurfaces(Edges=region_union)
populate_geometry = PopulateGeometry(Geometry=boundary_surfaces_4, Count=number_slider_3, Seed=1)
distance = Distance(PointA=populate_geometry, PointB=evaluate_surface.Point)
sort_list = SortList(Keys=distance, ValuesValuesA=populate_geometry)  # -> Keys, ValuesValuesA
number_slider_4 = Slider(1, range=0..1)
multiplication = Multiplication(A=number_slider_4, B=number_slider_3)
integer = Integer(multiplication)
split_list = SplitList(List=sort_list.ValuesValuesA, Index=integer)  # -> ListA, ListB
# Evolutionary Engine
number_slider_5 = Slider(0.7, range=0..1)
point = Point(split_list.ListA)
pull_point = PullPoint(Point=point, Geometry=python_3_script.OfficeBreps, ClosestOnly=True)  # -> ClosestPoint, Distance, Index
galapagos = Galapagos(fitness=python_3_script_4, gene=[number_slider_4, number_slider_5, number_slider_2, number_slider])
average = Average(Input=flatten(pull_point.Distance))
# Pre & Post Analysis
python_3_script_4 = Python3Script(
    BaseTemp=python_3_script_2.BaseTemp,
    SolarGHI=python_3_script_2.SolarGHI,
    TowerBreps=python_3_script.OfficeBreps,
    ResidentialBreps=python_3_script.ResidentialBreps,
    PedestrianArea=mass_addition.Result,
    VehicularArea=mass_addition_2.Result,
    PedestrianDensity="1.5",
    GreeneryRatio=number_slider_4,
    CoolPaverRatio=number_slider_5,
    AvgTreeDist=average,
    GlassRatio=python_3_script_3.GlassRatio)  # -> out, BeforeTemp, BeforePTSI, AfterTemp, AfterPTSI, TempDelta, PTSIDropPercent, AsphaltRetrofitted, FitnessScore, HUD_Text; inputs BaseTemp: Double, SolarGHI: Double, TowerBreps: list of Brep, ResidentialBreps: list of Brep, PedestrianArea: Double, VehicularArea: Double, PedestrianDensity: Double, GreeneryRatio: Double, CoolPaverRatio: Double, AvgTreeDist: Double, GlassRatio: Double
# ---------- python_3_script_4: Python ----------
import rhinoscriptsyntax as rs
import Rhino.Geometry as rg

# 1. Input Safety & Null Handling
safe_base_temp = BaseTemp if BaseTemp is not None else 35.0
safe_solar_ghi = SolarGHI if SolarGHI is not None else 850.0
safe_ped_area = PedestrianArea if PedestrianArea is not None else 450.0
safe_veh_area = VehicularArea if VehicularArea is not None else 800.0
safe_ped_density = PedestrianDensity if PedestrianDensity is not None else 1.5
safe_green_ratio = GreeneryRatio if GreeneryRatio is not None else 0.0
safe_paver_ratio = CoolPaverRatio if CoolPaverRatio is not None else 0.0

# 2. Extract Geometry Data (Separating Commercial vs. Residential)
total_tower_volume = 0.0
total_facade_area = 0.0
total_res_volume = 0.0

if TowerBreps:
    for brep in TowerBreps:
        if brep:
            total_tower_volume += brep.GetVolume()
            total_facade_area += brep.GetArea()

if ResidentialBreps:
    for brep in ResidentialBreps:
        if brep:
            total_res_volume += brep.GetVolume()

# 3. BASELINE CALCULATIONS (BEFORE)
# Commercial offices have high HVAC rejection (0.0001); Residential is much lower (0.00002)
raw_hvac = (total_tower_volume * 0.0001) + (total_res_volume * 0.00002)
# Replace the raw glare penalty calculation in Component B with this:
safe_glass_ratio = GlassRatio if GlassRatio is not None else 0.55

# Specular reflection is now dynamically driven by FortyGuard's actual facade vision data
raw_glare = (total_facade_area * safe_glass_ratio) * (safe_solar_ghi * 0.00002)
glare_penalty = min(raw_glare, 5.0)

hvac_penalty = min(raw_hvac, 6.0)
glare_penalty = min(raw_glare, 4.0)

BeforeTemp = safe_base_temp + hvac_penalty + glare_penalty
BeforePTSI = BeforeTemp * safe_ped_density

# 4. GENERATIVE INTERVENTIONS (AFTER)
safe_tree_dist = AvgTreeDist if AvgTreeDist is not None else 50.0

# SPATIAL INTELLIGENCE: Trees closer to hot glass towers multiply their cooling effect (Max 2x bonus)
spatial_multiplier = min(2.0, max(1.0, 30.0 / max(safe_tree_dist, 1.0)))

tree_cooling = (safe_green_ratio * 0.5) * 1.5 * spatial_multiplier       
shrub_cooling = (safe_green_ratio * 0.3) * 0.8      
groundcover_cooling = (safe_green_ratio * 0.2) * 0.5 
delta_t_green = tree_cooling + shrub_cooling + groundcover_cooling

total_hardscape = safe_ped_area + safe_veh_area
ped_weight = safe_ped_area / total_hardscape if total_hardscape > 0 else 0.5
veh_weight = safe_veh_area / total_hardscape if total_hardscape > 0 else 0.5

ped_material_cooling = (safe_paver_ratio * ped_weight) * 2.2 
veh_material_cooling = (safe_paver_ratio * veh_weight) * 1.1 
delta_t_materials = ped_material_cooling + veh_material_cooling

louver_mitigation = 0.0
if glare_penalty > 1.5 and safe_green_ratio > 0.4:
    louver_mitigation = glare_penalty * 0.7 

AfterTemp = BeforeTemp - (delta_t_green + delta_t_materials + louver_mitigation)
AfterPTSI = AfterTemp * safe_ped_density

# 5. EVOLUTIONARY FITNESS SCORE
w1, w2, w3, w4 = 0.4, 0.4, 0.1, 0.1
FitnessScore = (w1 * AfterTemp) + (w2 * AfterPTSI) - (w3 * (safe_green_ratio * 100)) + (w4 * (glare_penalty - louver_mitigation))

# 6. HUD OUTPUT METRICS
TempDelta = BeforeTemp - AfterTemp
PTSIDropPercent = ((BeforePTSI - AfterPTSI) / BeforePTSI) * 100 if BeforePTSI > 0 else 0.0
AsphaltRetrofitted = safe_ped_area * safe_paver_ratio

HUD_Text = "OUROBOROS: IMPACT REPORT\n"
HUD_Text += "----------------------------------\n"
HUD_Text += "Pre-Intervention Ambient: {:.2f} °C\n".format(BeforeTemp)
HUD_Text += "Post-Intervention Ambient: {:.2f} °C\n".format(AfterTemp)
HUD_Text += "Net Temperature Delta: -{:.2f} °C\n".format(TempDelta)
HUD_Text += "Pedestrian Thermal Stress Reduction: -{:.1f} %\n".format(PTSIDropPercent)
HUD_Text += "Total Pedestrian Asphalt Retrofitted: {:.0f} m²".format(AsphaltRetrofitted)
# ---------- end python_3_script_4 ----------
impact_report = Panel(python_3_script_4.HUD_Text)

geometry = Geometry(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)
# Visualising
orient = Orient(Geometry=geometry, Source=PlaneXY(0, 0, 0), Target=point)  # -> Geometry, Transform
gradient = Gradient(
    LowerLimit=0,
    UpperLimit=1,
    Parameter=number_slider_5,
    stops=[0: RGB(64, 64, 64), 0: RGB(168, 241, 22), 0: RGB(128, 128, 128), 0: RGB(13, 80, 144), 0: RGB(156, 51, 6), 0: RGB(252, 185, 104), 0: RGB(249, 48, 204), 0: RGB(18, 40, 131), 0: RGB(152, 98, 42), 0: RGB(140, 85, 220)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])
plane = Plane(Plane(origin=(30, 207, 0), x=(0.9237710987, -0.38294511, 0), y=(0.38294511, 0.9237710987, 0)))
custom_preview = CustomPreview(Geometry=boundary_surfaces_3, Material=ColourSwatch(SwatchColor=RGB(77, 79, 76)))
text_tag_3d = TextTag3D(
    Location=plane,
    Text=python_3_script_4.HUD_Text,
    Size=Slider(5, range=1..10),
    Colour=ColourSwatch(SwatchColor=RGB(255, 255, 255)),
    Justification=7)
custom_preview_2 = CustomPreview(Geometry=orient.Geometry, Material=ColourSwatch(SwatchColor=RGB(116, 219, 72)))
custom_preview_3 = CustomPreview(Geometry=boundary_surfaces_2, Material=gradient)
